% Simulink design studies Figure 07-08.mldatx for model Fig0708

study "Fig. 07-08 (Rankin & Broster, 1992) Experiment 1": 4 simulations
  combinatorial set (4 points):
    "ISI": BlockParameter(BlockPath=Fig0708/Target Stimulus/Pulse Generator, Name=Period), values [2 10 30 60] (4 points)