% Simulink design studies Figure 10.mldatx for model Fig10

study "Fig. 10 (9 ISI x 2 Retention intervals)": 18 simulations
  combinatorial set (18 points):
    "ISI": BlockParameter(BlockPath=Fig10/Target Stimulus/ISI, Name=Value), values [2 4 8 16 32 64 128 256 512] (9 points)
    "RI": BlockParameter(BlockPath=Fig10/Target Stimulus/RI, Name=Value), values [1800 3600] (2 points)