% Simulink design studies Figure 11.mldatx for model Fig11

study "Fig. 11 (Theoretical process-Intensity)": 2 simulations
  combinatorial set (2 points):
    "Intensity": BlockParameter(BlockPath=Fig11/Target Stimulus/Intensity, Name=Value), values [0.9 0.5] (2 points)