% Simulink design studies Figure 12.mldatx for model Fig12

study "Fig. 12 (Davis & Wagner, 1968)": 8 simulations
  combinatorial set (8 points):
    "Intensity habituation": BlockParameter(BlockPath=Fig12/Target Stimulus/Intensity habituation, Name=Value), values [0.9 0.5] (2 points)
    "Trials": BlockParameter(BlockPath=Fig12/Target Stimulus/Trials, Name=Value), values [6 14] (2 points)
    sequential set "Sequential combination" (2 points):
      "Intensity test 1": BlockParameter(BlockPath=Fig12/Target Stimulus/Intensity 1, Name=Value), values [0.9 0.5] (2 points)
      "Intensity test 2": BlockParameter(BlockPath=Fig12/Target Stimulus/Intensity 2, Name=Value), values [0.5 0.9] (2 points)