% Simulink design studies Figure 13.mldatx for model Fig0708

study "Fig. 13 (James & Hughes, 1969)": 4 simulations
  combinatorial set (4 points):
    "Intensity 1": BlockParameter(BlockPath=Fig13/Target Stimulus/Intensity 1, Name=Value), values [0.2 0.8] (2 points)
    "Intensity 2": BlockParameter(BlockPath=Fig13/Target Stimulus/Intensity 2, Name=Value), values [0.4 0.6] (2 points)