% Simulink design studies Figure 14.mldatx for model Fig15

study "Fig. 14 (9 Intensities x 2 Retention intervals)": 18 simulations
  combinatorial set (18 points):
    "RI": BlockParameter(BlockPath=Fig14/Target Stimulus/RI, Name=Value), values [1800 3600] (2 points)
    "Intensity": BlockParameter(BlockPath=Fig14/Target Stimulus/Intensity, Name=Value), values 0.1:0.1:0.9 (9 points)