% Simulink design studies Figure 15-16 Davis.mldatx for model Fig09

study "Fig. 15-16 (Davis, 1970) Experiment 1": 81 simulations
  combinatorial set (81 points):
    sequential set "pd1/lambda a" (9 points):
      "pd1": BlockParameter(BlockPath=Fig09/pd1, Name=Value), values 0.1:0.1:0.9 (9 points)
      "lambda a": BlockParameter(BlockPath=Fig09/Lambda afb, Name=Value), values [0.6, 1.2, 1.7, 2.3, 2.8, 3.4, 3.9, 4.5, 5.0] (9 points)
    sequential set "r" (9 points):
      "r SOP": BlockParameter(BlockPath=Fig09/r SOP, Name=Value), values 1:9 (9 points)
      "r fb": BlockParameter(BlockPath=Fig09/r fb, Name=Value), values 1:9 (9 points)