% Simulink design studies Figure 15-16 Rankin.mldatx for model Fig0708

study "Fig. 15-16 (Rankin & Broster, 1992)": 81 simulations
  combinatorial set (81 points):
    sequential set "pd1/lamda a" (9 points):
      "pd1": BlockParameter(BlockPath=Fig0708/pd1, Name=Value), values 0.1:0.1:0.9 (9 points)
      "lambda a": BlockParameter(BlockPath=Fig0708/Lambda afb, Name=Value), values [0.6, 1.2, 1.7, 2.3, 2.8, 3.4, 3.9, 4.5, 5.0] (9 points)
    sequential set "r" (9 points):
      "r SOP": BlockParameter(BlockPath=Fig0708/r SOP, Name=Value), values 1:9 (9 points)
      "r fb": BlockParameter(BlockPath=Fig0708/r fb, Name=Value), values 1:9 (9 points)