% Simulink design studies Figure 17-18.mldatx for model Fig1617

study "Fig. 17-18(81 conditions)": 81 simulations
  combinatorial set (81 points):
    "ISI": BlockParameter(BlockPath=Fig1718/Target Stimulus/ISI, Name=Value), values [2 4 8 16 32 64 128 256 512] (9 points)
    "Intensity": BlockParameter(BlockPath=Fig1718/Target Stimulus/Intensity, Name=Value), values [0.1:0.1:0.9] (9 points)