% Simulink design studies Figure 5.mldatx for model Fig05

study "Fig. 05 Theoretical process SOP-ISI": 4 simulations
  combinatorial set (4 points):
    sequential set "Sequential combination" (2 points):
      "ISI": BlockParameter(BlockPath=Fig05/Target Stimulus/Pulse Generator1, Name=Period), values [10 60] (2 points)
      "Prestim": BlockParameter(BlockPath=Fig05/Target Stimulus/Pulse Generator1, Name=PhaseDelay), values [180 30] (2 points)
    "Context Learning": BlockParameter(BlockPath=Fig05/Vc-s/Context Learning, Name=Gain), values [0 0.15] (2 points)