% Simulink design studies Figure 6.mldatx for model Fig06

study "Fig. 06 Theoretical process MTS-ISI": 2 simulations
  combinatorial set (2 points):
    sequential set "Sequential combination" (2 points):
      "ISI": BlockParameter(BlockPath=Fig06/Target Stimulus1/Pulse Generator, Name=Period), values [10 60] (2 points)
      "Prestim": BlockParameter(BlockPath=Fig06/Target Stimulus1/Pulse Generator, Name=PhaseDelay), values [180 30] (2 points)