% Simulink design studies Figure 9.mldatx for model Fig09

study "Fig. 09 (Davis, 1970) Experiment 1": 24 simulations
  combinatorial set (24 points):
    sequential set "Sequential combination" (6 points):
      "T1": BlockParameter(BlockPath=Fig09/Target Stimulus/T1, Name=Value), values [2 2 2 16 16 16] (6 points)
      "T2": BlockParameter(BlockPath=Fig09/Target Stimulus/T2, Name=Value), values [4 18 18 32 18 18] (6 points)
      "T3": BlockParameter(BlockPath=Fig09/Target Stimulus/T3, Name=Value), values [20 20 34 34 20 34] (6 points)
    "ISI": BlockParameter(BlockPath=Fig09/Target Stimulus/ISI, Name=Value), values [2 16] (2 points)
    "RI": BlockParameter(BlockPath=Fig09/Target Stimulus/RI, Name=Value), values [60 86400] (2 points)